# Grasshopper definition Compute_Tower_39.gh (Grasshopper 1.0.7)
# plug-ins: Kangaroo2 Components, Kangaroo Components

srf = Surface([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])

# ---- group: ORIGINAL
srf_2 = Surface([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])

# ---- group: Finales
srf_3 = Surface([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])

# ----
wires = BrepWireframe(Brep=srf_3, Density=-1)
area = Area(Geometry=srf_3)  # -> Area, Centroid
join = JoinCurves(Curves=wires, Preserve=False)  # -> flatten(Curves)
pdecon = Deconstruct(Point=area.Centroid)  # -> XComponent, YComponent, ZComponent
sort = SortList(Keys=pdecon.ZComponent, ValuesA=join)  # -> Keys, ValuesA
panel = Panel(sort.Keys)
item = ListItem(List=sort.ValuesA, Index=Slider(47, range=0..100), Wrap=True)
item_2 = ListItem(List=sort.ValuesA, Index=Slider(26, range=0..100), Wrap=True)
item_3 = ListItem(List=sort.ValuesA, Index=Slider(1, range=0..1), Wrap=True)
item_4 = ListItem(List=sort.ValuesA, Index=Slider(71, range=0..100), Wrap=True)
project = Project(Geometry=item_3, Plane=PlaneXY(0, 0, 0))  # -> Geometry, Transform
project_2 = Project(Geometry=item_2, Plane=PlaneXY(0, 0, 0))  # -> Geometry, Transform
project_3 = Project(Geometry=item, Plane=PlaneXY(0, 0, 0))  # -> Geometry, Transform
project_4 = Project(Geometry=item_4, Plane=PlaneXY(0, 0, 0))  # -> Geometry, Transform
loft = Loft(Curves=sort.ValuesA, Options={Adjust=False, Closed=False, LoftEnds=0, LoftSimp=0, LoftType=0, Rebuild=10, Refit=0.01})
neg = Negative(Value=Slider(1.3, range=0..100))
cluster = Cluster(crv=flatten(item_2), num=neg)
area_2 = Area(Geometry=loft)  # -> Area, Centroid
yz = YZPlane(Origin=Point(0, 0, 0))
xz = XZPlane(Origin=Point(0, 0, 0))
crvprox = CurveProximity(CurveA=project_2.Geometry, CurveB=project.Geometry)  # -> PointA, PointB, Distance
crvprox_2 = CurveProximity(CurveA=project_2.Geometry, CurveB=project_3.Geometry)  # -> PointA, PointB, Distance
crvprox_3 = CurveProximity(CurveA=project_2.Geometry, CurveB=project_4.Geometry)  # -> PointA, PointB, Distance
panel_2 = Panel(area_2.Area)
pcx = CurvePlane(Curve=flatten(cluster), Plane=yz)  # -> Points, ParamsC, ParamsP
pcx_2 = CurvePlane(Curve=flatten(cluster), Plane=xz)  # -> Points, ParamsC, ParamsP
pdecon_2 = Deconstruct(Point=pcx.Points)  # -> XComponent, YComponent, ZComponent
number_slider = Slider(1, range=0..1)
pdecon_3 = Deconstruct(Point=pcx_2.Points)  # -> XComponent, YComponent, ZComponent
sort_2 = SortList(Keys=pdecon_2.YComponent, ValuesA=pcx.ParamsC, ValuesB=pcx.Points)  # -> Keys, ValuesA, ValuesB
sort_3 = SortList(Keys=pdecon_3.XComponent, ValuesA=pcx_2.ParamsC, ValuesB=pcx_2.Points)  # -> Keys, ValuesA, ValuesB
number_slider_2 = Slider(1, range=0..100)
item_5 = ListItem(List=sort_2.ValuesA, Index=number_slider, Wrap=True)
item_6 = ListItem(List=sort_2.ValuesB, Index=number_slider, Wrap=True)
item_7 = ListItem(List=sort_3.ValuesA, Index=0, Wrap=True)
number_slider_3 = Slider(16, range=0..100)
seam = Seam(Curve=flatten(cluster), Seam=item_5)
seam_2 = Seam(Curve=flatten(cluster), Seam=item_5)
number_slider_4 = Slider(8, range=0..100)
seam_3 = Seam(Curve=flatten(cluster), Seam=item_7)
seam_4 = Seam(Curve=flatten(cluster), Seam=item_7)
filter = StreamFilter(Gate=number_slider_2, Stream0=Slider(16, range=0..100), Stream1=Slider(10, range=0..100))
pt = Point(area.Centroid)
divide = DivideCurve(Curve=seam, Count=number_slider_3, Kinks=False)  # -> Points, Tangents, Parameters
divide_2 = DivideCurve(Curve=seam_3, Count=number_slider_3, Kinks=False)  # -> Points, Tangents, Parameters
divide_3 = DivideCurve(Curve=seam_2, Count=filter, Kinks=False)  # -> Points, Tangents, Parameters
divide_4 = DivideCurve(Curve=seam_4, Count=filter, Kinks=False)  # -> Points, Tangents, Parameters
dispatch = Dispatch(List=divide_3.Points, DispatchPattern=[True, False])  # -> ListA, ListB
project_5 = Project(Geometry=divide_2.Points, Plane=PlaneXY(0, 0, 0))  # -> Geometry, Transform
dispatch_2 = Dispatch(List=divide_4.Points, DispatchPattern=[True, False])  # -> ListA, ListB
filter_2 = StreamFilter(Gate=number_slider_2, Stream0=Slider(-2, range=-10..0), Stream1=Slider(-3, range=-10..0))
pdecon_4 = Deconstruct(Point=pt)  # -> XComponent, YComponent, ZComponent
project_6 = Project(Geometry=divide.Points, Plane=PlaneXY(0, 0, 0))  # -> Geometry, Transform
neg_2 = Negative(Value=Slider(-3, range=-10..0))
pt_2 = Point(dispatch.ListB)
range = Range(Domain=Domain(0, 1), Steps=Slider(6, range=0..10))
sort_4 = SortList(Keys=pdecon_4.ZComponent)  # -> Keys, ValuesA
neg_3 = Negative(Value=filter_2)
pt_3 = Point(dispatch_2.ListA)
graph = GraphMapper(
    range,
    x0=0,
    x1=1,
    y0=0,
    y1=1,
    container_name="Bezier",
    cpx=[0, 0.3223703802, 0.6708427072, 1],
    cpy=[0, 0.2583466172, 0.5874242783, 1])
number_slider_5 = Slider(6, range=0..10)
number_slider_6 = Slider(1, range=0..1)
shift = ShiftList(List=project_6.Geometry, Shift=neg_2, Wrap=True)
filter_3 = StreamFilter(Gate=number_slider_2, Stream0=pt_3, Stream1=divide_4.Points)
filter_4 = StreamFilter(Gate=number_slider_2, Stream0=pt_2, Stream1=divide_3.Points)
lng = ListLength(List=sort_4.Keys)
project_7 = Project(Geometry=filter_3, Plane=PlaneXY(0, 0, 0))  # -> Geometry, Transform
project_8 = Project(Geometry=filter_4, Plane=PlaneXY(0, 0, 0))  # -> Geometry, Transform
division = Division(A=lng, B=number_slider_5)
dom = ConstructDomain(DomainStart=number_slider_6, DomainEnd=lng)
graph_2 = GraphMapper(
    range,
    x0=0,
    x1=1,
    y0=0,
    y1=1,
    container_name="Bezier",
    cpx=[0, 0.5446796417, 0.7484784722, 1],
    cpy=[0, 0.1623684764, 0.580129981, 1])
graph_3 = GraphMapper(range, x0=0, x1=1, y0=0, y1=1, Cx=0.5434782505, Cy=0.4782608747, container_name="Conic")
series = Series(Start=Slider(1, range=0..1), Step=division, Count=number_slider_5)
range_2 = Range(Domain=Domain(0, 1), Steps=Slider(3, range=0..10))
shift_2 = ShiftList(List=project_8.Geometry, Shift=neg_3, Wrap=True)
graph_4 = GraphMapper(
    range_2,
    x0=0,
    x1=1,
    y0=0,
    y1=1,
    A=1,
    B=0,
    container_name="Linear",
    Graph_x0=0.25,
    Graph_x1=0.75,
    Graph_y0=0.25,
    Graph_y1=0.75)
number_slider_7 = Slider(-1, range=-1..0)
remap = RemapNumbers(Value=graph_2, Source=Domain(0, 1), Target=dom)  # -> Mapped, Clipped
round = Round(Number=remap.Mapped)  # -> Nearest, Floor, Ceiling
shift_3 = ShiftList(List=graph_4, Shift=1, Wrap=False)
cull_i = CullIndex(List=graph_4, Indices=number_slider_7, Wrap=True)
shift_4 = ShiftList(List=round.Nearest, Shift=1, Wrap=False)
subtraction = Subtraction(A=shift_3, B=cull_i)
panel_3 = Panel("""3
2
1""")
subtraction_2 = Subtraction(A=shift_4, B=Slider(1, range=0..1))
merge = Merge(Data1=number_slider_6, Data2=subtraction_2)  # -> flatten(Result)
division_2 = Division(A=graft(subtraction), B=graft(panel_3))
dup = DuplicateData(Data=division_2, Number=graft(panel_3), Order=True)
cull_i_2 = CullIndex(List=merge, Indices=number_slider_7, Wrap=True)
dom_2 = ConstructDomain(DomainStart=0, DomainEnd=lng)
panel_4 = Panel(cull_i_2)
python = GhPythonScript(x=flatten(dup))  # -> out, a; inputs x: list
# ---------- python: Python ----------
__author__ = "Arquitectura"
__version__ = "2020.05.14"

import rhinoscriptsyntax as rs

list = []
count = 0
list.append(count)
for i in range(len(x)-1):
    count += x[i]
    list.append(count)

a= list
# ---------- end python ----------
remap_2 = RemapNumbers(Value=flatten(python.a), Source=Domain(0, 1), Target=dom_2)  # -> Mapped, Clipped
round_2 = Round(Number=remap_2.Mapped)  # -> Nearest, Floor, Ceiling
shift_5 = ShiftList(List=cull_i_2, Shift=1, Wrap=False)
cull_i_3 = CullIndex(List=cull_i_2, Indices=number_slider_7, Wrap=True)
panel_5 = Panel(python.a)
addition = Addition(A=round_2.Nearest, B=Slider(1, range=0..1))
subtraction_3 = Subtraction(A=shift_5, B=cull_i_3)
replace = ReplaceItems(List=round_2.Nearest, Item=Slider(1, range=0..1), Indices=Slider(0, range=0..100), Wrap=False)
panel_6 = Panel(subtraction_3)
item_8 = ListItem(List=sort_4.Keys, Index=cull_i_2, Wrap=True)
number_slider_8 = Slider(0, range=0..1)
number_slider_9 = Slider(112, range=0..1000)
number_slider_10 = Slider(112, range=0..1000)
number_slider_11 = Slider(112, range=0..1000)
item_9 = ListItem(List=item_8, Index=0, Wrap=True)  # -> Item, Item1, Item2, Item3, Item4, Item5
subtraction_4 = Subtraction(A=item_9.Item, B=Slider(0, range=-10..1))
subtraction_5 = Subtraction(A=item_9.Item1, B=Slider(0, range=-10..1))
number_slider_12 = Slider(204.4, range=0..1000)
subtraction_6 = Subtraction(A=item_9.Item5, B=Slider(0, range=-10..1))
subtraction_7 = Subtraction(A=item_9.Item3, B=Slider(0, range=-10..1))
number_slider_13 = Slider(204.4, range=0..1000)
Z = UnitZ(Factor=subtraction_4)
pt_4 = Point(shift_2)
Z_2 = UnitZ(Factor=subtraction_5)
Z_3 = UnitZ(Factor=subtraction_6)
number_slider_14 = Slider(1, range=0..100)
num = Number(number_slider_14)
filter_5 = StreamFilter(Gate=num, Stream1=shift_2)
Z_4 = UnitZ(Factor=subtraction_7)
move = Move(Geometry=filter_5, Motion=Z)  # -> Geometry, Transform
subtraction_8 = Subtraction(A=Slider(310.45, range=0..1000), B=Slider(-0.2, range=-10..1))
subtraction_9 = Subtraction(A=item_9.Item4, B=Slider(0, range=-10..1))
subtraction_10 = Subtraction(A=item_9.Item2, B=Slider(0, range=-10..1))
filter_6 = StreamFilter(Gate=num, Stream1=pt_4)
filter_7 = StreamFilter(Gate=num, Stream1=pt_4)
filter_8 = StreamFilter(Gate=num, Stream1=pt_4)
filter_9 = StreamFilter(Gate=number_slider_14, Stream1=project_7.Geometry)
filter_10 = StreamFilter(Gate=number_slider_14, Stream1=project_7.Geometry)
filter_11 = StreamFilter(Gate=number_slider_14, Stream1=project_7.Geometry)
Z_5 = UnitZ(Factor=subtraction_8)
Z_6 = UnitZ(Factor=subtraction_9)
Z_7 = UnitZ(Factor=subtraction_10)
move_2 = Move(Geometry=filter_7, Motion=Z_5)  # -> Geometry, Transform
move_3 = Move(Geometry=filter_8, Motion=Z_6)  # -> Geometry, Transform
move_4 = Move(Geometry=filter_6, Motion=Z_7)  # -> Geometry, Transform
move_5 = Move(Geometry=filter_9, Motion=Z_2)  # -> Geometry, Transform
move_6 = Move(Geometry=filter_11, Motion=Z_4)  # -> Geometry, Transform
move_7 = Move(Geometry=filter_10, Motion=Z_3)  # -> Geometry, Transform
entwine = Entwine(
    Branch00=move.Geometry,
    Branch01=move_5.Geometry,
    Branch02=move_4.Geometry,
    Branch03=move_6.Geometry,
    Branch04=move_3.Geometry,
    Branch05=move_7.Geometry,
    Branch06=move_2.Geometry,
    FlattenInputs=True)
pt_5 = Point(entwine)
pline = PolyLine(Vertices=pt_5, Closed=True)
brep = Brep([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])
item_10 = ListItem(List=flatten(pline), Index=0, Wrap=True)
area_3 = Area(Geometry=pline)  # -> Area, Centroid

# ---- group: RH_IN:201:Count
number_slider_15 = Slider(1.2, range=0..10)

# ----
number_slider_16 = Slider(1.2, range=-2..100)
xy = XYPlane(Origin=area_3.Centroid)
list = ValueList({"Small": 1, "Big": 0}, selected="Big")
sec = BrepPlane(Brep=brep, Plane=xy)  # -> Curves, Points
sec_2 = BrepPlane(Brep=loft, Plane=xy)  # -> Curves, Points
filter_12 = StreamFilter(Gate=number_slider_2, Stream0=Slider(1.1, range=-2..100), Stream1=number_slider_15)
flip = FlipCurve(Curve=sec_2.Curves)  # -> Curve, Flag
neg_4 = Negative(Value=filter_12)
pshift = ShiftPaths(Data=sec.Curves, Offset=-1)

# ---- group: RH_IN:201:Length
number_slider_17 = Slider(0.5, range=0..10)

# ----
number_slider_18 = Slider(0.5, range=0..1)

# ---- group: RH_IN:201:Radius
number_slider_19 = Slider(0.5, range=0..10)

# ----
cluster_2 = Cluster(crv=flip.Curve, num=neg_4)
number_slider_20 = Slider(0.5, range=0..1)
cluster_3 = Cluster_3(crv=flip.Curve, num=filter_12, G=list)
area_4 = Area(Geometry=pshift)  # -> Area, Centroid
pdecon_5 = Deconstruct(Point=area_3.Centroid)  # -> XComponent, YComponent, ZComponent
number_slider_21 = Slider(5, range=0..10)
project_9 = Project(Geometry=area_4.Centroid, Plane=PlaneXY(0, 0, 0))  # -> Geometry, Transform
Z_8 = UnitZ(Factor=pdecon_5.ZComponent)
X = UnitX(Factor=1)
pt_6 = ConstructPoint(XCoordinate=0, YCoordinate=0, ZCoordinate=0)
tstat = TreeStatistics(Tree=cluster_3)  # -> Paths, Length, Count
offset = OffsetCurve(Curve=cluster_3, Distance=Slider(0.3, range=0..1), Plane=PlaneXY(0, 0, 0), Corners=1)
Y = UnitY(Factor=1)
rev = Reverse(Vector=X)
filter_13 = StreamFilter(Gate=number_slider_2, Stream0=Slider(0, range=-2..100), Stream1=number_slider_19)
filter_14 = StreamFilter(Gate=number_slider_2, Stream0=Slider(0, range=-2..100), Stream1=number_slider_17)
vec2pt = Vector2Pt(PointA=pt_6, PointB=graft(project_9.Geometry), Unitize=False)  # -> Vector, Length
item_11 = ListItem(List=tstat.Paths, Index=number_slider_21, Wrap=True)  # -> Item, Item1
pl = ConstructPlane(Origin=Point(0, 0, 0), XAxis=rev, YAxis=Y)
int = Integer(number_slider_21)
int_2 = Integer(expr("x+1", int))
angle = Angle(VectorA=vec2pt.Vector, VectorB=rev, Plane=pl)  # -> Angle, Reflex
branch = TreeBranch(Tree=cluster_3, Path=item_11.Item, MaintainPaths=True)
list_2 = ValueList({"Small": 1, "Big": 0}, selected="Small")
branch_2 = TreeBranch(Tree=cluster_3, Path=item_11.Item1, MaintainPaths=True)
list_3 = ValueList({"Small": 1, "Big": 0}, selected="Big")
merge_2 = Merge(Data1=int, Data2=int_2)  # -> flatten(Result)
pshift_2 = ShiftPaths(Data=angle.Angle, Offset=-1)
cluster_4 = Cluster_3(crv=branch, num=filter_14, G=list_2)
cluster_5 = Cluster_3(crv=branch_2, num=filter_13, G=list_3)
sort_5 = SortList(Keys=pshift_2, ValuesA=project_9.Geometry)  # -> Keys, ValuesA, ValuesB
pline_2 = PolyLine(Vertices=sort_5.ValuesA, Closed=True)
merge_3 = Merge(Data1=cluster_4, Data2=cluster_5)  # -> flatten(Result)
explode = Explode(Curve=pline_2, Recursive=True)  # -> Segments, Vertices
eval = EvaluateCurve(Curve=reparameterize(explode.Segments), Parameter=Slider(0.5, range=0..1))  # -> Point, Tangent, Angle
replace_2 = ReplaceItems(List=flatten(cluster_3), Item=merge_3, Indices=merge_2, Wrap=False)  # -> simplify(graft(List))
weave = Weave(Pattern=[0, 1], Stream0=sort_5.ValuesA, Stream1=eval.Point, NullGaps=False)
crv = Curve(replace_2)
pshift_3 = ShiftPaths(Data=weave, Offset=-1)
tstat_2 = TreeStatistics(Tree=pshift_3)  # -> Paths, Length, Count
panel_7 = Panel("""True
False
False
True
False
False
False
True
False
False
False
False
False
True
False
False
False
True
False
False""")
dispatch_3 = Dispatch(List=tstat_2.Paths, DispatchPattern=[True, False])  # -> ListA, ListB
area_5 = Area(Geometry=sort.ValuesA)  # -> Area, Centroid
panel_8 = Panel("True")
branch_3 = TreeBranch(Tree=pshift_3, Path=dispatch_3.ListA, MaintainPaths=True)
panel_9 = Panel("""True
False
False
False
True
False
False
False
False
True
False
False
False
False
True
False
False
False""")
rev_2 = ReverseList(List=panel_7)
item_12 = ListItem(List=tstat_2.Paths, Index=0, Wrap=True)  # -> Item, Item1
branch_4 = TreeBranch(Tree=pshift_3, Path=dispatch_3.ListB, MaintainPaths=True)
shift_6 = ShiftList(List=sort.ValuesA, Shift=1, Wrap=False)
shift_7 = ShiftList(List=area_5.Centroid, Shift=1, Wrap=False)
shift_8 = ShiftList(List=branch_4, Shift=Slider(-1, range=-1..0), Wrap=True)
cull = CullPattern(List=branch_3, CullPattern=panel_9)
split = SplitList(List=cull, Index=Slider(5, range=0..10))  # -> ListA, ListB
cull_2 = CullPattern(List=shift_8, CullPattern=panel_7)
xz_2 = XZPlane(Origin=Point(0, 0, 0))
pt_7 = Point(split.ListA)
mirror = Mirror(Geometry=split.ListA, Plane=xz_2)  # -> Geometry, Transform
rev_3 = ReverseList(List=mirror.Geometry)
merge_4 = Merge(Data1=pt_7, Data2=rev_3)
points = PointList(Points=merge_4)
points_2 = PointList(Points=cull_2)
merge_5 = Merge(Data1=merge_4, Data2=cull_2)
pshift_4 = ShiftPaths(Data=merge_5, Offset=-1)

move_8 = Move(Geometry=pshift_4, Motion=Z_8)  # -> Geometry, Transform
pt_8 = Point(pt_5)

tstat_3 = TreeStatistics(Tree=pt_8)  # -> Paths, Length, Count
panel_10 = Panel("""-1
-2""")
crv_2 = Curve(crv)
item_13 = ListItem(List=tstat_3.Paths, Index=panel_10, Wrap=True)
item_14 = ListItem(List=flatten(crv_2), Index=0, Wrap=True)  # -> Item1, Item
branch_5 = TreeBranch(Tree=pt_8, Path=item_13, MaintainPaths=True)  # -> flatten(Branch)
crv_cp = CurveClosestPoint(Point=pt_8, Curve=crv_2)  # -> Point, Parameter, Distance
crv_cp_2 = CurveClosestPoint(Point=branch_5, Curve=item_14.Item1)  # -> Point, Parameter, Distance
curvature = Curvature(Curve=crv_2, Parameter=crv_cp.Parameter)  # -> P, K, C
curvature_2 = Curvature(Curve=item_14.Item1, Parameter=crv_cp_2.Parameter)  # -> P, K, C
line = LineSDL(Start=curvature.P, Direction=curvature.K, Length=Slider(41.45, range=0..100))
darc = DeconstructArc(Arc=curvature_2.C)  # -> BasePlane, Radius, Angle
line_2 = LineSDL(Start=curvature_2.P, Direction=curvature_2.K, Length=Slider(41.45, range=0..100))
tstat_4 = TreeStatistics(Tree=line)  # -> Paths, Length, Count
deplane = DeconstructPlane(Plane=darc.BasePlane)  # -> Origin, XAxis, YAxis, ZAxis
item_15 = ListItem(List=tstat_4.Paths, Index=panel_10, Wrap=True)
shift_9 = ShiftList(List=tstat_4.Paths, Shift=Slider(-1, range=-1..0), Wrap=False)
duppt = RemoveDuplicatePts(Points=deplane.Origin, Tolerance=0.01)
branch_6 = TreeBranch(Tree=line, Path=shift_9, MaintainPaths=True)  # -> flatten(Branch)
pt_9 = Point(pt_8)
crv_cp_3 = CurveClosestPoint(Point=pt_9, Curve=crv_2)  # -> Point, Parameter, Distance
crv_cp_4 = CurveClosestPoint(Point=pt_9, Curve=crv_2)  # -> Point, Parameter, Distance
tstat_5 = TreeStatistics(Tree=crv_cp_3.Point)  # -> Paths, Length, Count
pline_3 = PolyLine(Vertices=crv_cp_4.Point, Closed=True)
points_3 = PointList(Points=crv_cp_4.Point)
shift_10 = ShiftList(List=tstat_5.Paths, Shift=1, Wrap=False)
tstat_6 = TreeStatistics(Tree=crv_cp_4.Point)  # -> Paths, Length, Count
area_6 = Area(Geometry=pline_3)  # -> Area, Centroid
dispatch_4 = Dispatch(List=shift_10, DispatchPattern=invert([True, False]))  # -> ListA, ListB
dispatch_5 = Dispatch(List=shift_10, DispatchPattern=[True, False])  # -> ListA, ListB
dispatch_6 = Dispatch(List=tstat_6.Paths, DispatchPattern=invert([True, False]))  # -> ListA, ListB
dispatch_7 = Dispatch(List=tstat_6.Paths, DispatchPattern=[True, False])  # -> ListA, ListB
sort_6 = SortList(Keys=flatten(area_6.Area), ValuesA=flatten(pline_3))  # -> Keys, ValuesA
short = ShortestList(ListA=dispatch_5.ListA, ListB=dispatch_5.ListB, TrimMode=2)  # -> ListA, ListB
item_16 = ListItem(List=flatten(pline_3), Index=0, Wrap=True)  # -> Item1, Item
pdecon_6 = Deconstruct(Point=flatten(area_6.Centroid))  # -> XComponent, YComponent, ZComponent
short_2 = ShortestList(ListA=dispatch_7.ListA, ListB=dispatch_7.ListB, TrimMode=2)  # -> ListA, ListB
short_3 = ShortestList(ListA=dispatch_4.ListA, ListB=dispatch_4.ListB, TrimMode=2)  # -> ListA, ListB
short_4 = ShortestList(ListA=dispatch_6.ListA, ListB=dispatch_6.ListB, TrimMode=2)  # -> ListA, ListB
item_17 = ListItem(List=sort_6.ValuesA, Index=0, Wrap=True)  # -> Item2, Item1, Item
number_slider_22 = Slider(0, range=-1..0)
number_slider_23 = Slider(-1, range=-1..0)
branch_7 = TreeBranch(Tree=crv_cp_3.Point, Path=short.ListB, MaintainPaths=True)
branch_8 = TreeBranch(Tree=crv_cp_3.Point, Path=short.ListA, MaintainPaths=True)
crv_3 = Curve(item_16.Item1)
crv_4 = Curve(item_17.Item1)
branch_9 = TreeBranch(Tree=crv_cp_4.Point, Path=short_2.ListB, MaintainPaths=True)
branch_10 = TreeBranch(Tree=crv_cp_3.Point, Path=short_3.ListB, MaintainPaths=True)
branch_11 = TreeBranch(Tree=crv_cp_3.Point, Path=short_3.ListA, MaintainPaths=True)
branch_12 = TreeBranch(Tree=crv_cp_4.Point, Path=short_2.ListA, MaintainPaths=True)
crv_5 = Curve([item_17.Item1, item_17.Item2])
branch_13 = TreeBranch(Tree=crv_cp_4.Point, Path=short_4.ListB, MaintainPaths=True)
branch_14 = TreeBranch(Tree=crv_cp_4.Point, Path=short_4.ListA, MaintainPaths=True)
explode_2 = Explode(Curve=crv_4, Recursive=True)  # -> Segments, Vertices
shift_11 = ShiftList(List=branch_8, Shift=Slider(1, range=0..1), Wrap=True)
shift_12 = ShiftList(List=branch_12, Shift=Slider(-1, range=-1..0), Wrap=True)
shift_13 = ShiftList(List=branch_11, Shift=Slider(-1, range=-1..0), Wrap=True)
shift_14 = ShiftList(List=branch_14, Shift=Slider(1, range=0..1), Wrap=True)
eval_2 = EvaluateCurve(Curve=reparameterize(explode_2.Segments), Parameter=Slider(0.5, range=0..1))  # -> Point, Tangent, Angle
len = Length(Curve=explode_2.Segments)
ln = Line(StartPoint=shift_11, EndPoint=branch_7)
ln_2 = Line(StartPoint=branch_8, EndPoint=branch_7)
ln_3 = Line(StartPoint=shift_12, EndPoint=branch_9)
ln_4 = Line(StartPoint=branch_12, EndPoint=branch_9)
ln_5 = Line(StartPoint=shift_13, EndPoint=branch_10)
ln_6 = Line(StartPoint=branch_11, EndPoint=branch_10)
ln_7 = Line(StartPoint=shift_14, EndPoint=branch_13)
ln_8 = Line(StartPoint=branch_14, EndPoint=branch_13)
sort_7 = SortList(Keys=flatten(len))  # -> Keys, ValuesA
merge_6 = Merge(Data1=simplify(graft(ln_2)), Data2=simplify(graft(ln)))
merge_7 = Merge(Data1=simplify(graft(ln_4)), Data2=simplify(graft(ln_3)))
merge_8 = Merge(Data1=simplify(graft(ln_6)), Data2=simplify(graft(ln_5)))
merge_9 = Merge(Data1=simplify(graft(ln_8)), Data2=simplify(graft(ln_7)))
item_18 = ListItem(List=sort_7.Keys, Index=0, Wrap=True)  # -> Item1, Item
loft_2 = Loft(Curves=merge_6, Options={Adjust=False, Closed=False, LoftEnds=0, LoftSimp=0, LoftType=0, Rebuild=10, Refit=0.01})
loft_3 = Loft(Curves=merge_8, Options={Adjust=False, Closed=False, LoftEnds=0, LoftSimp=0, LoftType=0, Rebuild=10, Refit=0.01})
loft_4 = Loft(Curves=merge_7, Options={Adjust=False, Closed=False, LoftEnds=0, LoftSimp=0, LoftType=0, Rebuild=10, Refit=0.01})
loft_5 = Loft(Curves=merge_9, Options={Adjust=False, Closed=False, LoftEnds=0, LoftSimp=0, LoftType=0, Rebuild=10, Refit=0.01})
division_3 = Division(A=item_18.Item1, B=Slider(2, range=0..10))
flip_2 = FlipCurve(Curve=merge_6)  # -> Curve, Flag
pshift_5 = ShiftPaths(Data=loft_2, Offset=-1)
pshift_6 = ShiftPaths(Data=loft_4, Offset=-1)
pshift_7 = ShiftPaths(Data=loft_5, Offset=-1)
pshift_8 = ShiftPaths(Data=loft_3, Offset=-1)
merge_10 = Merge(Data1=pshift_6, Data2=pshift_7)
merge_11 = Merge(Data1=pshift_5, Data2=pshift_8)
entwine_2 = Entwine(Branch0X=merge_10, Branch1X=merge_11, FlattenInputs=False)
md_slider = MDSlider(SliderMode=0, slider_value=Point(0.5, 0.5, 0.5), x_domain=Domain(0, 1), y_domain=Domain(0, 1), z_domain=Domain(0, 1))
evalsrf = EvaluateSurface(Surface=reparameterize(entwine_2), Point=md_slider)  # -> Point, Normal, UDirection, VDirection, Frame
amp = Amplitude(Vector=evalsrf.Normal, Amplitude=Slider(0.2, range=0..1))
join_2 = BrepJoin(Breps=flatten(entwine_2))  # -> Breps, Closed
move_9 = Move(Geometry=evalsrf.Point, Motion=amp)  # -> Geometry, Transform
cap = CapHoles(Brep=join_2.Breps)
brepinc = PointInBrep(Brep=cap, Point=move_9.Geometry, Strict=False)
xy_2 = XYPlane(Origin=shift_7)
cull_3 = CullPattern(List=evalsrf.Normal, CullPattern=invert(brepinc))
cull_4 = CullPattern(List=evalsrf.Normal, CullPattern=brepinc)
sec_3 = BrepPlane(Brep=flatten(join_2.Breps), Plane=xy_2)  # -> flatten(Curves), Points
rev_4 = Reverse(Vector=cull_3)
explode_3 = Explode(Curve=sec_3.Curves, Recursive=True)  # -> Segments, Vertices
merge_12 = Merge(Data1=cull_4, Data2=rev_4)
duppt_2 = RemoveDuplicatePts(Points=explode_3.Vertices, Tolerance=0.01)
pline_4 = PolyLine(Vertices=duppt_2, Closed=True)
boundary = BoundarySurfaces(Edges=graft([pline_4, crv_3]))
panel_11 = Panel("""2
3""")
cluster_6 = Cluster_2(crv=[pline_4, crv_3], num=Slider(0.3, range=0..1))
area_7 = Area(Geometry=boundary)  # -> Area, Centroid
cull_i_4 = CullIndex(List=flatten(cluster_6), Indices=panel_11, Wrap=True)
boundary_2 = BoundarySurfaces(Edges=graft(cull_i_4))
ma = MassAddition(Input=flatten(area_7.Area))  # -> Result, PartialResults
area_8 = Area(Geometry=cull_i_4)  # -> Area, Centroid
disc = Discontinuity(Curve=cull_i_4, Level=1)  # -> Points, Parameters
area_9 = Area(Geometry=cull_i_4)  # -> Area, Centroid
Z_9 = UnitZ(Factor=Slider(0.4, range=0..1))
panel_12 = Panel(ma.Result)
ma_2 = MassAddition(Input=flatten(area_8.Area))  # -> Result, PartialResults
extr = Extrude(Base=boundary_2, Direction=Z_9)
md_slider_2 = MDSlider(SliderMode=0, slider_value=Point(0.5, 0.5, 0.5), x_domain=Domain(0, 1), y_domain=Domain(0, 1), z_domain=Domain(0, 1))
xy_3 = XYPlane(Origin=area_9.Centroid)  # -> graft(Plane)
debrep = DeconstructBrep(Brep=extr)  # -> Faces, Edges, Vertices
mesh = MeshBrep(
    Brep=extr,
    Settings={GridMaxCount=0, GridMinCount=16, JaggedSeams=False, MaxEdgeLength=0, MinEdgeLength=0.0001, MinTolerance=0, Refine=True, RefineAngle=0, RelativeTolerance=0.65, SimplePlanes=True, Tolerance=0})
del = DelaunayMesh(Points=disc.Points, Plane=graft(xy_3))
wires_2 = BrepWireframe(Brep=graft(debrep.Faces), Density=-1)
evalsrf_2 = EvaluateSurface(Surface=reparameterize(debrep.Faces), Point=md_slider_2)  # -> Point, Normal, UDirection, VDirection, Frame
join_3 = JoinCurves(Curves=wires_2, Preserve=False)
item_19 = ListItem(List=flatten(del), Index=0, Wrap=True)  # -> Item, Item1
mjoin = MeshJoin(Meshes=flatten(del))
explode_4 = Explode(Curve=join_3, Recursive=True)  # -> Segments, Vertices
duppt_3 = RemoveDuplicatePts(Points=explode_4.Vertices, Tolerance=0.01)
del_2 = DelaunayMesh(Points=duppt_3, Plane=graft(evalsrf_2.Frame))  # -> flatten(Mesh)
del_3 = DelaunayMesh(Points=duppt_3, Plane=graft(evalsrf_2.Frame))
pshift_9 = ShiftPaths(Data=simplify(del_3), Offset=-1)
mjoin_2 = MeshJoin(Meshes=pshift_9)  # -> flatten(Mesh)
item_20 = ListItem(List=mjoin_2, Index=Slider(1, range=0..1), Wrap=True)
mjoin_3 = MeshJoin(Meshes=flatten(del_2))
flipm = FlipMesh(Mesh=mjoin_3, VertexNormals=True, FaceNormals=True, FaceOrientation=True)
mesh_2 = MeshBrep(
    Brep=join_2.Breps,
    Settings={GridMaxCount=0, GridMinCount=16, JaggedSeams=False, MaxEdgeLength=0, MinEdgeLength=0.0001, MinTolerance=0, Refine=True, RefineAngle=0, RelativeTolerance=0.65, SimplePlanes=True, Tolerance=0})
mjoin_4 = MeshJoin(Meshes=flatten([mesh, mesh_2]))
smesh = SimpleMesh(Brep=join_2.Breps)
mesh_3 = Mesh([item_19.Item, item_19.Item1])
xz_3 = XZPlane(Origin=Point(0, 0, 0))
mjoin_5 = MeshJoin(Meshes=flatten([smesh, mesh_3]))
pflip = FlipPlane(Plane=xz_3, ReverseX=False, ReverseY=True, SwapAxes=False)
number_slider_24 = Slider(0.1, range=0..0.1)
number_slider_25 = Slider(1, range=0..1000)
orient = Orient(Geometry=mjoin_4, Source=PlaneXY(0, 0, 0), Target=pflip)  # -> Geometry, Transform
mjoin_6 = MeshJoin(Meshes=orient.Geometry)
scale = Scale(Geometry=mjoin_6, Center=Point(0, 0, 0), Factor=Slider(0.3, range=0..1))  # -> Geometry, Transform
c_script = CSharpScript(m=mjoin_6)  # -> out, A; inputs m: Mesh
# ---------- c_script: C# usings ----------
using System.IO;
using System.Linq;
using System.Data;
using System.Drawing;
using System.Reflection;
using System.Windows.Forms;
using System.Xml;
using System.Xml.Linq;
using System.Runtime.InteropServices;

using Rhino.DocObjects;
using Rhino.Collections;
using GH_IO;
using GH_IO.Serialization;
# ---------- c_script: C# ----------
    A = Mesh.CreateFromSubD(SubD.CreateFromMesh(m), 0);
# ---------- end c_script ----------
# using System;
# using System.Collections.Generic;
# using System.Linq;
# using System.Web;
# 
# namespace Resthopper.Models
# {
#     public enum GHTypeCodes
#     {
#         Boolean = 101,
#         Point = 102,
#         Vector = 103,
#         Integer = 104,
#         Number = 105,
#         Text = 106,
#         Line = 107,
#         Curve = 108,
#         Circle = 109,
#         PLane = 110,
#         Rectangle = 111,
#         Box = 112,
#         Surface = 113,
#         Brep = 114,
#         Mesh = 115,
# 
#         Slider = 201,
#         BooleanToggle = 202,
# 
#         Panel = 301
# 
#         //gh_boolean = 1,
#         //gh_byte = 2,
#         //gh_int = 3,
#         //gh_long = 4,
#         //gh_float = 5,
#         //gh_double = 6,
#         //gh_decimal = 7,
#         //gh_DateTime = 8,
#         //gh_Guid = 9,
#         //gh_string = 10,
#         //gh_byteArray = 20,
#         //gh_doubleArray = 21,
#         //gh_SystemDrawingPoint = 30,
#         //gh_SystemDrawingPointF = 31,
#         //gh_SystemDrawingSize = 32,
#         //gh_SystemDrawngSizeF = 33,
#         //gh_SystemDrawingRectangleF = 35,
#         //gh_SystemDrawingColor = 36,
#         //gh_SystemDrawingBitmap = 37,
#         //gh_GH_IO_2dPoint = 50,
#         //gh_GH_IO_3dPoint = 51,
#         //gh_GH_IO_4dPoint = 52,
#         //gh_GH_IO_1dInterval = 60,
#         //gh_GH_IO_2dInterval = 61,
#         //gh_GH_IO_line = 70,
#         //gh_GH_IO_BoundingBox = 71,
#         //gh_GH_IO_Plane = 72,
#         //gh_GH_IO_version = 80
# 
#     }
# }
flipm_2 = FlipMesh(Mesh=c_script.A, VertexNormals=True, FaceNormals=True, FaceOrientation=True)
flipm_3 = FlipMesh(Mesh=mjoin_6, VertexNormals=True, FaceNormals=True, FaceOrientation=True)

# ---- group: RH_OUT:115:Mesh_TRC
mesh_4 = Mesh(flipm_3)

# ----
panel_13 = Panel(mesh_4)

# ==== cluster Cluster
crv = ClusterInput()
num = ClusterInput()
crv_2 = Curve(crv)
num_2 = Number(num)
offset = OffsetCurve(Curve=crv_2, Distance=num_2, Plane=PlaneXY(0, 0, 0), Corners=1)
area = Area(Geometry=crv_2)  # -> Area, Centroid
area_2 = Area(Geometry=offset)  # -> Area, Centroid
eval = Evaluate(F="x<y", x=area.Area, y=area_2.Area)
cull = CullPattern(List=crv_2, CullPattern=invert(eval))
cull_2 = CullPattern(List=offset, CullPattern=eval)
neg = Negative(Value=num_2)
offset_2 = OffsetCurve(Curve=cull, Distance=neg, Plane=PlaneXY(0, 0, 0), Corners=1)
merge = Merge(Data1=simplify(offset_2), Data2=simplify(cull_2))
R = ClusterOutput(merge)

# ==== cluster Cluster_2
crv = ClusterInput()
num = ClusterInput()
crv_2 = Curve(crv)
num_2 = Number(num)
offset = OffsetCurve(Curve=crv_2, Distance=num_2, Plane=PlaneXY(0, 0, 0), Corners=1)
area = Area(Geometry=crv_2)  # -> Area, Centroid
area_2 = Area(Geometry=offset)  # -> Area, Centroid
eval = Evaluate(F="x<y", x=area.Area, y=area_2.Area)
cull = CullPattern(List=offset, CullPattern=invert(eval))
cull_2 = CullPattern(List=crv_2, CullPattern=eval)
neg = Negative(Value=num_2)
offset_2 = OffsetCurve(Curve=cull_2, Distance=neg, Plane=PlaneXY(0, 0, 0), Corners=1)
merge = Merge(Data1=simplify(offset_2), Data2=simplify(cull))
R = ClusterOutput(merge)

# ==== cluster Cluster_3
G = ClusterInput()
crv = ClusterInput()
num = ClusterInput()
crv_2 = Curve(crv)
num_2 = Number(num)
offset = OffsetCurve(Curve=crv_2, Distance=num_2, Plane=PlaneXY(0, 0, 0), Corners=1)
area = Area(Geometry=crv_2)  # -> Area, Centroid
area_2 = Area(Geometry=offset)  # -> Area, Centroid
eval = Evaluate(F="x<y", x=area.Area, y=area_2.Area)
not = GateNot(A=eval)
filter = StreamFilter(Gate=G, Stream0=eval, Stream1=not)
cull = CullPattern(List=crv_2, CullPattern=invert(filter))
cull_2 = CullPattern(List=offset, CullPattern=filter)
neg = Negative(Value=num_2)
offset_2 = OffsetCurve(Curve=cull, Distance=neg, Plane=PlaneXY(0, 0, 0), Corners=1)
merge = Merge(Data1=simplify(offset_2), Data2=simplify(cull_2))
R = ClusterOutput(merge)
